test file "controller_testFile"
  coverage: Decision, MCDC, Condition

suite "Voter_TestKit"

  case "case1_Fail_A_AB_Harness" [baseline]
    model controller, harness A_AB_less0 (for controller/Vote1)
    test sequence scenario: A_AB_less0 (A_AB_less0/Test Sequence)
    iterations:
      Iteration1: TestSequenceScenario "A_AB_less0"
      Iteration2: TestSequenceScenario "A_AB_over1"
      Iteration3: TestSequenceScenario "A_AC_less0"
      Iteration4: TestSequenceScenario "A_AC_over1"
      Iteration5: TestSequenceScenario "B_BA_less0"
      Iteration6: TestSequenceScenario "B_BA_over1"
      Iteration7: TestSequenceScenario "B_BC_less0"
      Iteration8: TestSequenceScenario "B_BC_over1"
      Iteration9: TestSequenceScenario "C_AC_less0"
      Iteration10: TestSequenceScenario "C_AC_over1"
      Iteration11: TestSequenceScenario "C_BC_less0"
      Iteration12: TestSequenceScenario "C_BC_over1"
      Iteration13: TestSequenceScenario "A_AB"
      Iteration14: TestSequenceScenario "A_AC"
      Iteration15: TestSequenceScenario "B_BA"
      Iteration16: TestSequenceScenario "B_BC"
      Iteration17: TestSequenceScenario "C_CA"
      Iteration18: TestSequenceScenario "C_CB"

suite "CANbus_CheckerKit"

  case "Normal Driving" [baseline]
    model controller, harness CANchecker_Harness1 (for controller/CAN Signal Checker)
    signal scenario: x0Normal_Driving (CANchecker_Harness1/Harness Inputs)
    baseline "Normal_Driving_Baseline.mat"
      Brake_Pedal_Pressed:1
      AT Selector State:1
      Vehicle_Speed_km_h:1: abs tol 1
      CAN BUS Fail Mode:1

  case "BreakCAN_Fail" [baseline]
    model controller, harness CANchecker_Harness1 (for controller/CAN Signal Checker)
    signal scenario: x1BreakCAN_Fail (CANchecker_Harness1/Harness Inputs)
    baseline "BreakCAN_Fail_Baseline.mat"
      Brake Pedal Pressed
      AT Selector State
      Vehicle_Speed_km_h: abs tol 1
      CAN BUS Fail Mode

  case "ATselectorCAN_Fail" [baseline]
    model controller, harness CANchecker_Harness1 (for controller/CAN Signal Checker)
    signal scenario: x2ATselectorCAN_Fail (CANchecker_Harness1/Harness Inputs)
    baseline "ATselectorCAN_Fail_Baseline.mat"
      Brake Pedal Pressed
      AT Selector State
      Vehicle_Speed_km_h: abs tol 1
      CAN BUS Fail Mode

  case "SpeedCAN_Fail" [baseline]
    model controller, harness CANchecker_Harness1 (for controller/CAN Signal Checker)
    signal scenario: x3SpeedCAN_Fail (CANchecker_Harness1/Harness Inputs)
    baseline "SpeedCAN_Fail_Baseline.mat"
      Brake Pedal Pressed
      AT Selector State
      Vehicle_Speed_km_h: abs tol 1
      CAN BUS Fail Mode